# Grasshopper definition CISER-Script.ghx (Grasshopper 1.0.7)

sim = GhPythonScript()  # -> out, a; inputs wind_dirs: list of Int32, cpus_per_task: Int32, machines: list, tasks_per_machine: list of Int32
# ---------- sim: Python ----------
__author__ = "pk373"
__version__ = "2020.10.09"

import rhinoscriptsyntax as rs
import os

if not os.path.exists(working_dir + "\_ciser\\"):
    os.makedirs(working_dir + "\_ciser\\")


template = "call \"U:\cfd\setvars.bat\"\nset PATH=%HOME%\msys64\usr\\bin;%PATH%\n{3}\nrobocopy  {4}\{0}\ {2}\{0}\ /E \ncd \"{2}\{0}\" \n\nblockMesh \nsurfaceFeatureExtract \ndecomposePar -force \nmpiexec -np {1} snappyHexMesh -overwrite -parallel \nreconstructParMesh -constant \nrenumberMesh -overwrite"

dirName = os.path.join(working_dir , "\_ciser\\")
copy_from = "\\\\tsclient\\"+working_dir[0]+ str(working_dir[2:])

if not os.path.exists(dirName):
    os.makedirs(dirName)


template_f = template.format("mesh",cpus_per_task, CISER_dir, CISER_dir[:2], copy_from)
template_f  =template_f + "\n" + "\n"
for dir in wind_dirs:
    template_f += "robocopy " + CISER_dir + "\mesh\\ " + CISER_dir + "\\" + str(dir) + " /E \n"
    


if os.path.isfile(working_dir +"\_ciser\\_run_mesh.bat"):
    os.remove(working_dir +"\_ciser\\_run_mesh.bat")
   
f = open(working_dir +"\_ciser\\_run_mesh.bat", "a")
f.write(template_f)
f.close()
    




template = "call \"U:\cfd\setvars.bat\"\nset PATH=%HOME%\msys64\usr\\bin;%PATH%\n{3}\nrobocopy  {4}\{0}\ {2}\{0}\ /XD polyMesh /E \ncd \"{2}\{0}\" \n\ndecomposePar -force | tee -a log\nmpiexec -np {1} simpleFoam -parallel | tee -a log\nreconstructPar -latestTime | tee -a log"
dirName = os.path.join(working_dir , "\_ciser\\")

if not os.path.exists(dirName):
    os.makedirs(dirName)

for dir in wind_dirs:
    template_f = template.format(dir, cpus_per_task, CISER_dir, CISER_dir[:2], copy_from)
    if os.path.isfile(working_dir +"\_ciser\\"+str(dir)+"_run_sim.bat"):
        os.remove(working_dir +"\_ciser\\"+str(dir)+"_run_sim.bat")
   
    f = open(working_dir +"\_ciser\\"+str(dir)+"_run_sim.bat", "a")
    f.write(template_f)
    f.close()
    
    
template = "call \"U:\cfd\setvars.bat\"\nset PATH=%HOME%\msys64\usr\\bin;%PATH%\n{3}\ncd \"{2}\{0}\"\nmpiexec -np {1} simpleFoam -parallel | tee -a log\nreconstructPar -latestTime | tee -a log"
dirName = os.path.join(working_dir , "\_ciser\\")

if not os.path.exists(dirName):
    os.makedirs(dirName)

for dir in wind_dirs:
    template_f = template.format(dir, cpus_per_task, CISER_dir, CISER_dir[:2])
    if os.path.isfile(working_dir +"\_ciser\\"+str(dir)+"_run_sim_continue.bat"):
        os.remove(working_dir +"\_ciser\\"+str(dir)+"_run_sim_continue.bat")
    f = open(working_dir +"\_ciser\\"+str(dir)+"_run_sim_continue.bat", "a")
    f.write(template_f)
    f.close()
    
    
print(["s"+str(i+1) for i in range(len(machines))])




template = "call \"U:\cfd\setvars.bat\"\nset PATH=%HOME%\msys64\usr\\bin;%PATH%\n{3}\ncd \"{2}\{0}\"\nreconstructPar -latestTime | tee -a log"
dirName = os.path.join(working_dir , "\_ciser\\")

if not os.path.exists(dirName):
    os.makedirs(dirName)

for dir in wind_dirs:
    template_f = template.format(dir, cpus_per_task, CISER_dir, CISER_dir[:2])
    if os.path.isfile(working_dir +"\_ciser\\"+str(dir)+"_run_reconstruct.bat"):
        os.remove(working_dir +"\_ciser\\"+str(dir)+"_run_reconstruct.bat")
    f = open(working_dir +"\_ciser\\"+str(dir)+"_run_reconstruct.bat", "a")
    f.write(template_f)
    f.close()
    
    
print(["s"+str(i+1) for i in range(len(machines))])




template = "robocopy {1}\{0} \\\\tsclient\{2}\\{3} /XD processor*  /E /W:1 /R:1 \n"
s = []
dirName = os.path.join(working_dir , "\_ciser\\")
copy_from = "\\\\tsclient\\"+working_dir[0]+ str(working_dir[2:])

if not os.path.exists(dirName):
    os.makedirs(dirName)
    
s.append(template.format("mesh",  CISER_dir, working_dir, "mesh").replace("C:","C").replace("E:","E"))
for dir in wind_dirs:
    s.append(template.format(dir,  CISER_dir, working_dir, dir).replace("C:","C").replace("E:","E"))
print(s)
    

f = open(working_dir +"\_ciser\\_copy_to_local.bat", "w")

f.write(''.join(str(e) for e in s))
f.close()



template = "robocopy  \\\\tsclient\{2}\\{3}  {1}\{0}\\  /E /W:1 /R:1\n"
s = []

dirName = os.path.join(working_dir , "\_ciser\\")
copy_from = "\\\\tsclient\\"+working_dir[0]+ str(working_dir[2:])

if not os.path.exists(dirName):
    os.makedirs(dirName)

s.append(template.format("mesh",  CISER_dir, working_dir, "mesh").replace("C:","C").replace("E:","E"))
for dir in wind_dirs:
    s.append(template.format(dir,  CISER_dir, working_dir, dir).replace("C:","C").replace("E:","E"))

f = open(working_dir +"\_ciser\\_copy_to_ciser.bat", "w")

f.write(''.join(str(e) for e in s))
f.close()



template =  "call " + copy_from + "\_ciser\{0}_run_sim.bat"
dirName = os.path.join(working_dir , "\_ciser\\")

if not os.path.exists(dirName):
    os.makedirs(dirName)
    
def position(i,j,list):
    return sum(list[0:i])+j

for i,m in enumerate(machines):
    #print(i,m)
    s = ""
    for j in range(tasks_per_machine[i]):
        pos = position(i,j,tasks_per_machine)
        if pos < len(wind_dirs):
            template_f = template.format(wind_dirs[pos])
            s = s+template_f
        s= s+"\n"        

    if os.path.isfile(working_dir +"\_ciser\\"+m+".bat"):
        os.remove(working_dir +"\_ciser\\"+m+".bat")
    f = open(working_dir +"\_ciser\\"+m+".bat", "a")
    f.write(s)
    f.close()
    
    



    

if not os.path.exists(root_dir + "\_ciser\\"):
    os.makedirs(root_dir + "\_ciser\\")


for m in machines:
    s= "CallBatchRunner.exe -w . -t 1 -p "+m+".bat"
    dir = root_dir + "\_ciser\\"
    if os.path.isfile(dir+m+".bat"):
        os.remove(dir+m+".bat")
    f = open(dir+m+".bat", "a")
    f.write(s)
    f.close()
# ---------- end sim ----------
